# Grasshopper definition sapling_preview.gh (Grasshopper 1.0.8)

# ---- group: Material
number_slider = Slider(2100, range=0..10000)
number_slider_2 = Slider(0.0537, range=0..1)
number_slider_3 = Slider(0.3, range=0..1)
number_slider_4 = Slider(48.564, range=0..100)
number_slider_5 = Slider(2.835, range=-10.001..1000)
number_slider_6 = Slider(0.116, range=0..1)

# ---- group: Wall and print
number_slider_7 = Slider(19.2, range=0..100)
number_slider_8 = Slider(55, range=20..100)
number_slider_9 = Slider(9.5, range=0..10)
number_slider_10 = Slider(500, range=0..1000)
panel = Panel("simply")

# ---- group: Geometry
crv = Curve(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)

# ----
sapling = Python3Script(
    Path=crv,
    Tl=number_slider_7,
    h=number_slider_8,
    tl=number_slider_9,
    rho=number_slider,
    E0=number_slider_4,
    xiE=number_slider_2,
    sig0=number_slider_5,
    xiS=number_slider_6,
    nu=number_slider_3,
    b=number_slider_10,
    Edge=panel)  # -> Height, Layers, Mode, Report, Preview, Shape; inputs Path: Curve, Speed: Double, Tl: Double, h: Double, tl: Double, rho: Double, E0: Double, xiE: Double, sig0: Double, xiS: Double, nu: Double, b: Double, d: Double, Edge: String, gammaE: Double, Ky: Double, RectScaling: String, Htarget: Double, betaE: Double
# ---------- sapling: Python ----------
"""
Sapling 0.2.0 - buildability check for 3D concrete printing
GhPython component (Rhino 7 IronPython / Rhino 8 CPython) and plain module.

Implements the parametric model of Suiker (2018) for elastic buckling and
plastic collapse of a straight printed wall, with the extensions of
Wolfs & Suiker (2019) and Suiker et al. (2020). Pure Python, no numpy/scipy.

Use in Grasshopper: paste this whole file into a Python script component.
Use as a module:    import sapling; sapling.assess(...)   (SI units)

Scope: straight vertical walls of uniform thickness; free, simply supported,
clamped and rectangular lay-outs; linear, exponential and quadratic stiffness
curing; linear strength curing. See README.md for limitations.

Copyright (C) 2026 Ali Akbarzadeh
License: GPL-3.0-or-later

INPUTS (set these names + type hints on the component):
    Path     : Curve   one layer of the print path (optional)
    Speed    : float   nozzle speed [mm/s]           (used with Path)
    Tl       : float   layer time [s]                (used if Path empty)
    h        : float   layer width / wall thickness [mm]
    tl       : float   layer height [mm]
    rho      : float   density [kg/m3]
    E0       : float   initial Young's modulus [kPa]
    xiE      : float   stiffness curing rate [1/min]
    sig0     : float   initial yield strength [kPa]
    xiS      : float   strength curing rate [1/min]
    nu       : float   Poisson ratio (default 0.3)
    b        : float   wall width between supports [mm]
    d        : float   width of the supporting wall [mm]   (Edge = 'rect')
    Edge     : str     'free' | 'simply' | 'clamped' | 'rect'
    gammaE   : float   E_inf/E0 for exponential curing (empty = linear)
    betaE    : float   curing acceleration for quadratic curing (empty = 0)
    Ky       : float   coefficient of lateral stress (empty = nu)
    RectScaling : str  'paper' | 'consistent'  (see note in rect_profile)
    Htarget  : float   intended print height [mm] (optional, for the report)
OUTPUTS:
    Height   : critical height [mm]   (empty if no failure predicted)
               (the same value is also assigned to H, the v1-v3 output name)
    Layers   : number of layers at failure (None if no failure predicted)
    Mode     : 'elastic buckling' | 'plastic collapse' | 'no failure predicted'
    Report   : text summary
    Preview  : extrusion of Path up to Height (or Htarget when no failure)
    Shape    : buckling mode along the height, 21 values from bottom to top,
               normalised to 1 (empty unless the wall buckles). Amplitude is
               arbitrary; used by sapling_preview.py to draw the buckled wall.
"""
from __future__ import division
import math

__version__ = "0.2.0"

G = 9.81
INF = float("inf")


# ------------------------------------------------------------ curing
def _curing(Ebar, gamma):
    """g(a), dg/ds, d2g/ds2 with a = Ebar*(L - s), s measured from the bottom.
    gamma: None -> linear; float -> exponential with E_inf/E0 = gamma;
           ("quad", beta) -> quadratic, g = 1 + a + beta*a^2."""
    if isinstance(gamma, tuple):
        be = gamma[1]
        return (lambda a: 1.0 + a + be * a * a,
                lambda a: -Ebar * (1.0 + 2.0 * be * a),
                lambda a: 2.0 * be * Ebar ** 2)
    if gamma is None or gamma <= 0:
        return (lambda a: 1.0 + a, lambda a: -Ebar, lambda a: 0.0)
    return (lambda a: gamma + (1 - gamma) * math.exp(-a),
            lambda a: (1 - gamma) * Ebar * math.exp(-a),
            lambda a: (1 - gamma) * Ebar ** 2 * math.exp(-a))


# ------------------------------------------- Eqs. (37), (38), (57), (58)
def ny_of_kr(kr):
    return 1.984 * (1 - math.exp(-(0.360 * kr + 0.430) ** 0.452))


def cy_of_kr(kr):
    return 0.5 + 0.309 * math.exp(-0.854 * kr) + 0.192 * math.exp(-0.183 * kr)


def kr_inf_rect(b_over_d):
    """Asymptotic rotational stiffness of a rectangular lay-out, D0s = D0."""
    r = max(b_over_d, 1.0)
    n = 2.0 * r / (1.0 + r)                                   # Eq. (57)
    if n >= 1.984:
        return 1e9
    k = ((-math.log(1 - n / 1.984)) ** (1 / 0.452) - 0.430) / 0.360  # Eq. (58)
    return max(k, 0.0)


def _F(psi):
    """Eq. (69). Equals theta/theta0 of a simply supported beam of length d on
    a Winkler foundation under end moments, with psi = beta*d."""
    if psi < 1e-2:
        return 1.0
    if psi > 20.0:
        return 1.0 / psi
    e = math.exp
    s, c = math.sin(psi), math.cos(psi)
    num = (4 * s * c * (e(psi) + e(-psi)) + 2 * c * (e(2 * psi) - e(-2 * psi))
           - 2 * s * (e(2 * psi) + e(-2 * psi)) - 4 * s
           - e(3 * psi) + e(-3 * psi) - e(psi) + e(-psi))
    den = psi * (4 * c * c * (e(psi) + e(-psi)) - e(3 * psi) - e(-3 * psi)
                 - 3 * (e(psi) + e(-psi)))
    return num / den


def _flex(sp, L, Ebar, gamma, m=40):
    """Tip flexibility of the graded cantilever strip s1: int (sp-s)^2/g ds."""
    g = _curing(Ebar, gamma)[0]
    hs = sp / (2 * m)
    tot = 0.0
    for i in range(2 * m + 1):                                  # Simpson
        s = i * hs
        wgt = 1 if i in (0, 2 * m) else (4 if i % 2 else 2)
        tot += wgt * (sp - s) ** 2 / g(Ebar * (L - s))
    return tot * hs / 3


def rect_profile(L, Ebar, gamma, bbar, dbar, npts, scaling="paper"):
    """(n_y, c_y) at npts+1 equidistant heights for a rectangular lay-out.

    scaling = 'paper'      : psi = (kt_bar/4)^(1/4) with kt_bar of Eq. (67),
                             i.e. taken literally from Eqs. (67)-(69). This
                             reproduces l_cr = 3.05 of Sec. 5.2 (we get 3.01).
    scaling = 'consistent' : psi = d*(kt/(4 D))^(1/4), the dimensionally
                             consistent beam-on-foundation parameter. Gives a
                             lower l_cr (2.58 for the same case). Which one is
                             intended is an open question for the author.
    """
    krinf = kr_inf_rect(bbar / dbar)
    g = _curing(Ebar, gamma)[0]
    out = []
    for i in range(npts + 1):
        sp = L * i / npts
        if i == 0:
            kr = 1e9                                           # clamped bottom
        else:
            kt = 1.0 / _flex(sp, L, Ebar, gamma)
            if scaling == "paper" and Ebar > 0:
                psi = (kt / Ebar ** 3 / 4.0) ** 0.25
            else:
                psi = dbar * (kt / (4.0 * g(Ebar * (L - sp)))) ** 0.25
            kr = krinf / max(_F(psi), 1e-9)                      # Eq. (66)
        out.append((ny_of_kr(kr), cy_of_kr(kr)))
    return out


# ------------------------------------------------------------ core solver
def _det(L, Ebar, gamma, nu, Ky, bbar, prof, n, trace=None):
    """Shooting determinant of Eqs. (49), (54), (55); lengths in units of L0.
    prof: list of (n_y, c_y) at 2n+1 equidistant heights, or None (free wall)."""
    g, dg, d2g = _curing(Ebar, gamma)

    def coef(j):
        if prof is None:
            return 0.0, 0.0
        ny, cy = prof[j]
        b2 = (ny * math.pi / bbar) ** 2
        return cy * b2, b2

    def f(s, j, y):
        w, wp, m, mp = y
        a = Ebar * (L - s)
        gs, gps, gpps = g(a), dg(a), d2g(a)
        c, b2 = coef(j)
        wpp = m / gs
        mpp = (wp - (L - s) * wpp + 2 * c * (gps * wp + gs * wpp)
               - (c * b2 * gs - c * nu * gpps - c * Ky * (L - s)) * w)
        return [wp, wpp, mp, mpp]

    hs = L / n
    out = []
    for y in ([0.0, 0.0, 1.0, 0.0], [0.0, 0.0, 0.0, 1.0]):
        s = 0.0
        ws = [y[0]]
        for i in range(n):                                       # classic RK4
            k1 = f(s, 2 * i, y)
            k2 = f(s + hs / 2, 2 * i + 1, [y[q] + hs / 2 * k1[q] for q in range(4)])
            k3 = f(s + hs / 2, 2 * i + 1, [y[q] + hs / 2 * k2[q] for q in range(4)])
            k4 = f(s + hs, 2 * i + 2, [y[q] + hs * k3[q] for q in range(4)])
            y = [y[q] + hs / 6 * (k1[q] + 2 * k2[q] + 2 * k3[q] + k4[q])
                 for q in range(4)]
            s += hs
            ws.append(y[0])
        w, wp, m, mp = y
        gs, gps = g(0.0), dg(0.0)
        c, _ = coef(2 * n)
        out.append((m - c * nu * w,
                    mp - c * (nu * (gps * w + gs * wp) + 2 * (1 - nu) * gs * wp)))
        if trace is not None:
            trace.append((ws, out[-1][0], out[-1][1]))
    (a1, b1), (a2, b2) = out
    return a1 * b2 - b1 * a2


def _setup(L, Ebar, bbar, edge, gamma, dbar, scaling):
    """Number of RK4 steps and the (n_y, c_y) profile for wall length L."""
    n = int(max(120, min(600, 60 * L)))
    if edge == "free":
        prof = None
    elif edge == "simply":
        prof = [(1.0, 1.0)] * (2 * n + 1)
    elif edge == "clamped":
        prof = [(2.0, 0.5)] * (2 * n + 1)
    elif edge == "rect":
        prof = rect_profile(L, Ebar, gamma, bbar, dbar, 2 * n, scaling)
    else:
        raise ValueError("Edge must be free, simply, clamped or rect")
    return n, prof


def critical_length(Ebar, bbar=None, edge="free", nu=0.3, gamma=None,
                    Ky=None, dbar=None, scaling="paper", Lmax=60.0):
    """Dimensionless critical buckling length (in units of L0).
    Returns inf if no bifurcation is found below Lmax."""
    Ky = nu if Ky is None else Ky

    def D(L):
        n, prof = _setup(L, Ebar, bbar, edge, gamma, dbar, scaling)
        return _det(L, Ebar, gamma, nu, Ky, bbar, prof, n)

    L0 = 0.3
    d0 = D(L0)
    while L0 < Lmax:
        L1 = min(Lmax, L0 + max(0.1, 0.03 * L0))
        d1 = D(L1)
        if (d0 > 0) != (d1 > 0):
            for _ in range(40):                                  # bisection
                Lm = 0.5 * (L0 + L1)
                dm = D(Lm)
                if (dm > 0) == (d0 > 0):
                    L0, d0 = Lm, dm
                else:
                    L1 = Lm
            return 0.5 * (L0 + L1)
        L0, d0 = L1, d1
    return INF


def mode_shape(L, Ebar, bbar=None, edge="free", nu=0.3, gamma=None,
               Ky=None, dbar=None, scaling="paper", npts=20):
    """Buckling mode along the wall height at the critical length L.
    Returns npts+1 deflections at equidistant heights (bottom to top),
    normalised to a maximum of 1. The amplitude of a bifurcation mode is
    arbitrary; only the shape has a meaning."""
    Ky = nu if Ky is None else Ky
    n, prof = _setup(L, Ebar, bbar, edge, gamma, dbar, scaling)
    trace = []
    _det(L, Ebar, gamma, nu, Ky, bbar, prof, n, trace)
    (w1, a1, b1), (w2, a2, b2) = trace
    if abs(a1) + abs(a2) >= abs(b1) + abs(b2):
        c1, c2 = a2, -a1
    else:
        c1, c2 = b2, -b1
    w = [c1 * w1[i] + c2 * w2[i] for i in range(n + 1)]
    out = []
    for k in range(npts + 1):
        x = k * n / float(npts)
        i = min(n - 1, int(x))
        out.append(w[i] + (w[i + 1] - w[i]) * (x - i))
    big = max(abs(v) for v in out) or 1.0
    sign = 1.0 if out[-1] >= 0 else -1.0
    return [sign * v / big for v in out]


def assess(h, tl, Tl, rho, E0, nu, xiE, sig0, xiS, b=None, edge="free",
           gammaE=None, d=None, Ky=None, scaling="paper", Lmax=60.0,
           betaE=None):
    """SI units in, dict out."""
    if betaE:
        gammaE = ("quad", float(betaE))
    ldot = tl / Tl
    D0 = E0 * h ** 3 / (12 * (1 - nu ** 2))
    L0 = (D0 / (rho * G * h)) ** (1.0 / 3)
    Ebar = L0 * xiE / ldot
    bbar = None if b is None else b / L0
    dbar = None if d is None else d / L0
    abar = sig0 * xiS / (rho * G * ldot)
    lp = (sig0 / (rho * G)) / (1 - abar) if abar < 1 else INF
    # buckling beyond the plastic collapse length is irrelevant: bound the search
    limit = Lmax if lp == INF else min(Lmax, 1.02 * lp / L0 + 0.5)
    lcr = critical_length(Ebar, bbar, edge, nu, gammaE, Ky, dbar, scaling,
                          limit) * L0
    if lcr == INF and lp == INF:
        H, mode, n = None, "no failure predicted", None
    elif lcr < lp:
        H, mode, n = lcr, "elastic buckling", int(math.ceil(lcr / tl))
    else:  # +1 layer: constrained bottom layer (CCR 2020, Sec. 2.2)
        H, mode, n = lp, "plastic collapse", int(math.ceil(lp / tl)) + 1
    shape = None
    if mode == "elastic buckling":
        shape = mode_shape(lcr / L0, Ebar, bbar, edge, nu, gammaE, Ky, dbar,
                           scaling)
    warn = []
    if edge == "clamped" and Ebar > 0.5:
        warn.append("clamped wall at high curing rate: the model overestimates "
                    "FEM by up to 15% (Wolfs & Suiker 2019, Sec. 3.2); "
                    "'simply' is the safe bound")
    if H is not None and gammaE is None and H / ldot > 1200.0:
        warn.append("failure after %.0f min of printing: linear curing is "
                    "calibrated for short sessions and underestimated long "
                    "walls in Wolfs & Suiker 2019" % (H / ldot / 60.0))
    if edge == "rect" and isinstance(gammaE, float):
        warn.append("rectangular lay-out with exponential curing is outside "
                    "the published formulas (Eq. 67 is for linear curing)")
    return dict(ldot=ldot, D0=D0, L0=L0, Ebar=Ebar, bbar=bbar, abar=abar,
                lcr=lcr, lp=lp, H=H, mode=mode, n=n, limit=limit * L0,
                warnings=warn, shape=shape)


# ------------------------------------------------------- Grasshopper glue
def _gh_main():
    def val(name, default=None):
        v = globals().get(name)
        return default if v is None else v

    path, speed = val("Path"), val("Speed")
    if path is not None and speed:
        Tl_s = path.GetLength() / float(speed)
    else:
        Tl_s = float(val("Tl"))
    edge = (val("Edge", "free") or "free").strip().lower()
    bb, dd, tl_mm = val("b"), val("d"), val("tl")
    kw = dict(h=val("h") / 1000.0, tl=tl_mm / 1000.0, Tl=Tl_s,
              rho=val("rho", 2100.0), E0=val("E0") * 1000.0,
              nu=val("nu", 0.3), xiE=val("xiE") / 60.0,
              sig0=val("sig0") * 1000.0, xiS=val("xiS") / 60.0,
              b=None if bb is None else bb / 1000.0, edge=edge,
              gammaE=val("gammaE"),
              d=None if dd is None else dd / 1000.0, Ky=val("Ky"),
              scaling=(val("RectScaling", "paper") or "paper").strip().lower(),
              betaE=val("betaE"))
    # Results are kept per set of inputs, so returning to values that were
    # already solved (e.g. dragging a slider back) is immediate.
    try:
        import scriptcontext as sc
        cache = sc.sticky.setdefault("sapling_results", {})
    except ImportError:
        cache = {}
    key = tuple(sorted(kw.items()))
    if key not in cache:
        if len(cache) > 2000:
            cache.clear()
        cache[key] = assess(**kw)
    r = cache[key]

    def mm(x):
        return "none below %.0f mm" % (r["limit"] * 1000) if x == INF \
            else "%.0f mm (%.2f layers)" % (x * 1000, x * 1000 / tl_mm)

    lines = ["Layer time      : %.1f s" % Tl_s,
             "Wall growth     : %.3f mm/s" % (r["ldot"] * 1000),
             "Ebar / alpha    : %.3f / %.3f" % (r["Ebar"], r["abar"]),
             "Buckling length : " + mm(r["lcr"]),
             "Plastic length  : " + ("none (strength outgrows self-weight)"
                                     if r["lp"] == INF else mm(r["lp"]))]
    if r["H"] is None:
        lines.append("-> no failure predicted")
    else:
        lines.append("-> %s at %.0f mm (%d layers)"
                     % (r["mode"], r["H"] * 1000, r["n"]))
    for wmsg in r["warnings"]:
        lines.append("! " + wmsg)
    Hmm = None if r["H"] is None else r["H"] * 1000
    prev, top = None, Hmm if Hmm is not None else val("Htarget")
    if path is not None and top:
        import Rhino.Geometry as rg
        prev = rg.Surface.CreateExtrusion(path, rg.Vector3d(0, 0, top))
    return Hmm, r["n"], r["mode"], "\n".join(lines), prev, r["shape"]


try:
    import Rhino  # noqa: F401  (only inside Rhino)
    Height, Layers, Mode, Report, Preview, Shape = _gh_main()
    H = Height
except ImportError:
    pass
# ---------- end sapling ----------
panel_2 = Panel(sapling.Report)
panel_3 = Panel("story")
sapling_preview = Python3Script(
    Path=crv,
    h=number_slider_8,
    tl=number_slider_9,
    Step=Slider(32, range=0..40),
    Layers=sapling.Layers,
    Mode=sapling.Mode,
    Shape=sapling.Shape,
    Segments=Slider(120, range=0..1000))  # -> Printed, Nozzle, Printer, Status; inputs Path: Curve, Layers: Int32, Mode: String, Shape: list of Double, Edge: String, Play: Boolean, Rate: Double
# ---------- sapling_preview: Python ----------
"""
Sapling preview - animated print preview for Grasshopper (GhPython, Rhino 7/8)

Draws a gantry concrete printer, the printed layers and the failure that
Sapling predicts. Drag a slider connected to Step (or use Play + a Trigger)
to run the print. When Step reaches the failure layer the wall turns red and,
over the next three steps, deforms:

  * elastic buckling : the wall bends out of plane. The shape along the
    height is the buckling mode computed by Sapling (input Shape). The shape
    along the path is a half sine between supports or corners, alternating in
    and out on neighbouring walls of a closed lay-out. Layers turn with the
    bent wall and the top comes down as it bends.
  * plastic collapse : the lowest fifth of the wall yields: it is squashed
    and spreads sideways, and the wall above settles, a little unevenly.

The deformation is an illustration. A buckling mode has no defined amplitude,
so the amplitude here is chosen for visibility, and the collapse shape is a
sketch of the mechanism described in Suiker et al. (2020), not a computed
result. Do not read displacements off this preview.

INPUTS (names and type hints):
    Path     : Curve   one layer of the print path, drawn at z = 0 [mm]
    h        : float   wall thickness / layer width [mm]
    tl       : float   layer height [mm]
    Step     : float   layers printed so far, e.g. 12.4 = 12 layers + 40 %
    Layers   : int     failure layer            (Sapling output Layers)
    Mode     : str     failure mode             (Sapling output Mode)
    Shape    : float, List Access   mode shape  (Sapling output Shape)
    Edge     : str     free | simply | clamped  (open paths only; default free)
    Segments : int     samples along the path (default 120)
    Play     : bool    automatic playback, used when Step is not connected
    Tick     : any     connect a Trigger component here for automatic playback
    Rate     : float   layers per tick in automatic playback (default 0.05)
    Camera   : str     optional. Moves the camera of the active Rhino viewport
                       with Step, for recording with the slider's Animate:
                         story  = top view of the first layers, slow descent
                                  around the print, then a view square to one
                                  side of the frame that holds still during
                                  the failure and rises to look down on it
                         orbit  = plain turntable, one turn over the print
                       Leave empty to control the camera yourself.
    Zoom     : float   optional camera distance factor (default 1.0;
                       1.3 = 30 % farther away, 0.8 = closer)
OUTPUTS:
    Printed  : Mesh    printed layers, coloured by age (red after failure)
    Nozzle   : Mesh    moving parts of the printer: bridge, carriage, column, nozzle
    Printer  : Mesh    fixed parts: frame and print bed
    Status   : str     short text for a panel

License: GPL-3.0-or-later. Copyright (C) 2026 Ali Akbarzadeh
"""
from __future__ import division
import math

FRESH = (95, 95, 100)        # just deposited: dark, wet
CURED = (200, 198, 190)      # oldest layers: light
FAILED = (205, 60, 50)
STEEL = (120, 126, 135)
ACCENT = (235, 130, 35)
DARK = (40, 40, 45)
BED = (225, 225, 220)
BUILD = 10                    # raise when the geometry code changes: stored
                             # meshes from an older build are then ignored
COLLAPSE_STEPS = 3.0         # slider steps over which the failure develops


# ----------------------------------------------------------- small helpers
def _lerp(a, b, t):
    return tuple(int(round(a[i] + (b[i] - a[i]) * t)) for i in range(3))


def _interp(values, t):
    """Linear interpolation in a list for t in [0, 1]."""
    if not values:
        return t * t
    x = max(0.0, min(1.0, t)) * (len(values) - 1)
    i = min(len(values) - 2, int(x))
    return values[i] + (values[i + 1] - values[i]) * (x - i)


def _box(x0, x1, y0, y1, z0, z1, col, verts, faces, cols):
    b = len(verts)
    verts.extend([(x0, y0, z0), (x1, y0, z0), (x1, y1, z0), (x0, y1, z0),
                  (x0, y0, z1), (x1, y0, z1), (x1, y1, z1), (x0, y1, z1)])
    for f in ((0, 3, 2, 1), (4, 5, 6, 7), (0, 1, 5, 4),
              (1, 2, 6, 5), (2, 3, 7, 6), (3, 0, 4, 7)):
        faces.append(tuple(b + k for k in f))
    cols.extend([col] * 8)


# ------------------------------------------------- shape along the path
def find_corners(normals):
    """Indices of corner centres of a closed path, from the turning of the
    normal between equidistant samples. Empty for smooth paths."""
    n = len(normals)
    turn = []
    for i in range(n):
        a, b = normals[i], normals[(i + 1) % n]
        turn.append(abs(math.atan2(a[0] * b[1] - a[1] * b[0],
                                   a[0] * b[0] + a[1] * b[1])))
    thr = 2.5 * (2 * math.pi / n)
    hot = [t > thr for t in turn]
    if all(hot) or not any(hot):
        return []
    start = next(i for i in range(n) if hot[i] and not hot[i - 1])
    corners, i, seen = [], start, 0
    while seen < n:
        if hot[i % n]:
            j, wsum, isum = i, 0.0, 0.0
            while hot[j % n] and j - i < n:
                wsum += turn[j % n]
                isum += turn[j % n] * (j + 0.5)
                j += 1
            corners.append(isum / wsum)
            seen += j - i
            i = j
        else:
            i += 1
            seen += 1
    return corners


def lateral_factors(normals, closed, edge="free"):
    """Out-of-plane factor in [-1, 1] at every sample."""
    n = len(normals)
    if not closed:
        if edge == "simply":
            return [math.sin(math.pi * i / (n - 1)) for i in range(n)]
        if edge == "clamped":
            return [0.5 * (1 - math.cos(2 * math.pi * i / (n - 1))) for i in range(n)]
        return [1.0] * n                                  # free wall leans
    corners = find_corners(normals)
    if len(corners) < 3:                                  # smooth loop
        return [math.cos(4 * math.pi * i / n) for i in range(n)]
    walls = []
    for k in range(len(corners)):
        a = corners[k]
        b = corners[(k + 1) % len(corners)]
        if b <= a:
            b += n
        walls.append((a, b))
    longest = max(b - a for a, b in walls)
    out = [0.0] * n
    for k, (a, b) in enumerate(walls):
        sign = 1.0 if k % 2 == 0 else -1.0
        scale = ((b - a) / longest) ** 2                  # short walls move less
        i = int(math.ceil(a))
        while i < b:
            out[i % n] = sign * scale * math.sin(math.pi * (i - a) / (b - a))
            i += 1
    return out


# ------------------------------------------------------------ the wall
class Deform(object):
    """Maps an undeformed point of the wall to its displayed position.

    Elastic buckling is drawn as bending of the wall: the centre line moves
    out of plane by w(z) = amplitude x path factor x mode shape, every layer
    turns with the slope dw/dz, and the wall gets lower by the amount that
    bending without stretching requires (the integral of w'^2 / 2).

    Plastic collapse is drawn as yielding of the base: the lowest fifth of
    the wall is squashed and spreads sideways, most near the bed, and the
    wall above rides down on it. The settlement is not the same everywhere
    along the path, so the wall above ends up leaning slightly.

    Amplitudes are chosen for visibility; see the note at the top."""

    N = 40

    def __init__(self, mode, amount, h, tl, height, shape):
        e = _smooth(amount)                       # slow start, then fast
        self.buckle = e if mode == "elastic buckling" else 0.0
        self.crush = e if mode == "plastic collapse" else 0.0
        self.h, self.tl, self.height = h, tl, max(height, 1e-9)
        n = self.N
        S = [_interp(shape, k / float(n)) for k in range(n + 1)]
        self.S = S
        self.dS = [(S[min(n, k + 1)] - S[max(0, k - 1)]) * n /
                   float(min(n, k + 1) - max(0, k - 1)) for k in range(n + 1)]
        self.I = [0.0]                            # integral of dS^2 / 2
        for k in range(n):
            self.I.append(self.I[-1] + 0.25 * (self.dS[k] ** 2 + self.dS[k + 1] ** 2) / n)

    def point(self, x, y, nx, ny, fac, side, z):
        hw = 0.5 * self.h
        off = 0.0
        if self.crush:
            zone = max(3.0 * self.tl, 0.2 * self.height)
            drop = 0.5 * self.crush * (1.0 + 0.3 * fac)       # uneven settlement
            t = min(1.0, z / zone)
            # widening: largest just above the bed (the bed holds the very
            # bottom in place), fading out at the top of the yielded zone
            spread = 1.5 * self.crush * (1.0 + 0.3 * fac) * (1 - t) ** 1.5 * (0.35 + 0.65 * min(1.0, 4 * t))
            hw *= 1.0 + spread
            if z < zone:
                # more squashing near the bed than at the top of the zone
                z = zone * t * (1 - drop * (1.3 - 0.3 * t))
            else:
                lean = 0.07 * self.crush * fac                 # about 4 degrees
                off = lean * (z - zone)
                z = z - drop * zone
        if self.buckle:
            a = 1.5 * self.h * self.buckle * fac
            t = max(0.0, min(1.0, z / self.height))
            off = a * _interp(self.S, t)
            slope = a * _interp(self.dS, t) / self.height
            z = max(0.0, z - a * a * _interp(self.I, t) / self.height - side * hw * slope)
        return (x + nx * (side * hw + off), y + ny * (side * hw + off), z)


def strip(samples, closed, frac, z0, z1, deform, verts, faces):
    """Append one layer (or the first `frac` of it) as a box strip.
    samples: list of (x, y, nx, ny, factor)."""
    n = len(samples)
    seg_total = n if closed else n - 1
    nseg = int(math.floor(seg_total * frac + 1e-9))
    if nseg < 1:
        return
    base = len(verts)
    for i in range(nseg + 1):
        x, y, nx, ny, fac = samples[i % n]
        verts.append(deform.point(x, y, nx, ny, fac, +1, z0))
        verts.append(deform.point(x, y, nx, ny, fac, -1, z0))
        verts.append(deform.point(x, y, nx, ny, fac, -1, z1))
        verts.append(deform.point(x, y, nx, ny, fac, +1, z1))
    for i in range(nseg):
        a, b = base + 4 * i, base + 4 * (i + 1)
        faces.append((a, a + 3, b + 3, b))          # outer side
        faces.append((a + 1, b + 1, b + 2, a + 2))  # inner side
        faces.append((a + 3, a + 2, b + 2, b + 3))  # top
        faces.append((a, b, b + 1, a + 1))          # bottom
    if not (closed and nseg == seg_total):           # end caps
        e = base + 4 * nseg
        faces.append((base, base + 1, base + 2, base + 3))
        faces.append((e, e + 3, e + 2, e + 1))


def build_wall(points, normals, closed, h, tl, step, fail_layer=None,
               mode=None, shape=None, edge="free"):
    """Returns verts, faces, colours, nozzle tip (x, y, z), failure amount 0..1."""
    amount = 0.0
    if fail_layer is not None and step >= fail_layer:
        amount = min(1.0, (step - fail_layer) / COLLAPSE_STEPS)
        failed, step = True, float(fail_layer)
    else:
        failed = False
    full = int(math.floor(step + 1e-9))
    part = step - full
    plastic = mode == "plastic collapse"
    if failed and plastic:
        # slow variation along the path, used for uneven settlement
        m = float(len(points) if closed else 2 * (len(points) - 1))
        fac = [math.sin(2 * math.pi * i / m + 0.9) for i in range(len(points))]
    elif failed:
        fac = lateral_factors(normals, closed, edge)
    else:
        fac = [0.0] * len(points)
    fwd = [(points[i][0], points[i][1], normals[i][0], normals[i][1], fac[i])
           for i in range(len(points))]
    # an open path is printed back and forth: odd layers run in reverse.
    # The normal is flipped (and the factor with it) to keep the mesh winding.
    back = [(x, y, -nx, -ny, f if plastic else -f) for (x, y, nx, ny, f) in reversed(fwd)]
    deform = Deform(mode, amount, h, tl, full * tl, shape)

    def run(i):
        return fwd if (closed or i % 2 == 0) else back

    verts, faces, cols = [], [], []
    for i in range(full):
        v0 = len(verts)
        strip(run(i), closed, 1.0, i * tl, (i + 1) * tl, deform, verts, faces)
        age = (full - 1 - i) / (full - 1.0) if full > 1 else 0.0
        c = _lerp(FRESH, CURED, min(1.0, age * 1.5))
        if failed:
            c = _lerp(c, FAILED, 0.35 + 0.45 * amount)
        if i % 2:                                        # visible layer lines
            c = _lerp(c, (0, 0, 0), 0.16)
        cols.extend([c] * (len(verts) - v0))
    n = len(points)
    seg_total = n if closed else n - 1
    if failed:
        x, y = run(full)[0][:2]
        tip = (x, y, full * tl + 0.5 * tl)               # lifted clear, stopped
    elif part > 1e-6:
        v0 = len(verts)
        strip(run(full), closed, part, full * tl, (full + 1) * tl, deform, verts, faces)
        cols.extend([FRESH] * (len(verts) - v0))
        k = int(math.floor(seg_total * part + 1e-9))
        x, y = run(full)[k % n][:2]
        tip = (x, y, (full + 1) * tl)
    else:
        x, y = run(full)[0][:2]
        tip = (x, y, (full + 1) * tl)
    return verts, faces, cols, tip, (amount if failed else None)


# ------------------------------------------------------------ the printer
def _nozzle(tip, size, verts, faces, cols, sides=20):
    x0, y0, z0 = tip
    r, hc, hb = 0.45 * size, 0.8 * size, 1.4 * size
    rings = [(0.12 * size, 0.0), (r, hc), (r, hc + hb)]
    base = len(verts)
    for rad, dz in rings:
        for j in range(sides):
            a = 2 * math.pi * j / sides
            verts.append((x0 + rad * math.cos(a), y0 + rad * math.sin(a), z0 + dz))
    for k in range(len(rings) - 1):
        for j in range(sides):
            a, b = base + k * sides + j, base + k * sides + (j + 1) % sides
            faces.append((a, b, b + sides, a + sides))
    verts.append((x0, y0, z0))
    bot = len(verts) - 1
    for j in range(sides):
        faces.append((base + (j + 1) % sides, base + j, bot))
    cols.extend([DARK] * (len(verts) - base))
    return z0 + hc + hb


def frame_dims(points):
    """Beam size and clearance of the printer frame. They depend on the size
    of the print path only, so the printer does not change with the wall."""
    xs, ys = [p[0] for p in points], [p[1] for p in points]
    span = max(max(xs) - min(xs), max(ys) - min(ys))
    return max(60.0, 0.12 * span), max(250.0, 0.5 * span), span


def build_printer(points, tip, h, rail_z):
    """Gantry printer around the path. Returns (moving, fixed), each a
    (verts, faces, cols) triple. rail_z is the height of the top of the rails."""
    xs, ys = [p[0] for p in points], [p[1] for p in points]
    s, m, _ = frame_dims(points)                       # beam size, clearance
    x0, x1, y0, y1 = min(xs) - m, max(xs) + m, min(ys) - m, max(ys) + m
    tx, ty, _ = tip

    mv, mf, mc = [], [], []
    top = _nozzle(tip, 1.1 * s, mv, mf, mc)             # fixed size, like the frame
    _box(tx - 0.4 * s, tx + 0.4 * s, ty - 0.4 * s, ty + 0.4 * s,
         top, top + rail_z, STEEL, mv, mf, mc)                       # Z column
    _box(tx + 0.5 * s, tx + 1.5 * s, y0 - s, y1 + s,
         rail_z, rail_z + s, STEEL, mv, mf, mc)                      # bridge
    _box(tx - 0.7 * s, tx + 1.7 * s, ty - 0.9 * s, ty + 0.9 * s,
         rail_z - 0.3 * s, rail_z + 1.4 * s, ACCENT, mv, mf, mc)     # carriage

    fv, ff, fc = [], [], []
    for yy in (y0 - s, y1):
        _box(x0 - s, x1 + 2 * s, yy, yy + s, rail_z - s, rail_z, STEEL, fv, ff, fc)
        for xx in (x0 - s, x1 + s):
            _box(xx, xx + s, yy, yy + s, 0.0, rail_z - s, STEEL, fv, ff, fc)
    _box(x0, x1, y0 + s, y1 - s, -0.3 * s, 0.0, BED, fv, ff, fc)     # print bed
    return (mv, mf, mc), (fv, ff, fc)


# ------------------------------------------------------------ the camera
def _smooth(t):
    t = max(0.0, min(1.0, t))
    return t * t * (3 - 2 * t)


def camera_pose(step, fail, tl, centre, radius, style="story", zoom=1.0):
    """Camera target and location for a given Step.
    radius: half diagonal of the printer frame. Angles in degrees.
    Keys are (step, azimuth, elevation, distance / radius, target height)."""
    F = float(fail) if fail is not None else 40.0
    top = F * tl
    if style == "orbit":
        keys = [(0.0, -60.0, 28.0, 2.4, 0.4 * top),
                (F + COLLAPSE_STEPS + 3.0, 300.0, 28.0, 2.4, 0.4 * top)]
        ease = lambda t: max(0.0, min(1.0, t))           # constant speed
    else:
        a = min(2.5, 0.1 * F)                            # end of the top view
        b = max(a + 1.0, F - 5.0)                        # end of the descent
        keys = [(0.0, -90.0, 72.0, 2.1, 0.0),            # top view
                (a, -90.0, 72.0, 2.1, 0.0),
                (b, 120.0, 30.0, 2.5, 0.4 * top),        # descent around the print
                # From here the camera faces one side of the frame squarely
                # (azimuth 180: no rail on that side, posts left and right of
                # the print), so nothing passes in front of the failing wall.
                (F, 180.0, 22.0, 1.9, 0.6 * top),        # close-up
                (F + COLLAPSE_STEPS, 180.0, 22.0, 1.9, 0.6 * top),   # hold: failure
                (F + COLLAPSE_STEPS + 3.0, 180.0, 55.0, 2.2, 0.5 * top)]  # rise
        ease = _smooth
    k = keys[-1][1:]
    if step <= keys[0][0]:
        k = keys[0][1:]
    else:
        for k0, k1 in zip(keys, keys[1:]):
            s0, v0, s1, v1 = k0[0], k0[1:], k1[0], k1[1:]
            if step <= s1:
                t = ease((step - s0) / (s1 - s0)) if s1 > s0 else 1.0
                k = [v0[j] + (v1[j] - v0[j]) * t for j in range(4)]
                break
    az, el, dist, tz = math.radians(k[0]), math.radians(k[1]), k[2] * radius * 1.25 * zoom, k[3]
    target = (centre[0], centre[1], tz)
    loc = (centre[0] + dist * math.cos(el) * math.cos(az),
           centre[1] + dist * math.cos(el) * math.sin(az),
           tz + dist * math.sin(el))
    return target, loc


def _set_camera(rg, target, loc):
    import Rhino
    view = Rhino.RhinoDoc.ActiveDoc.Views.ActiveView
    if view is None:
        return
    view.ActiveViewport.SetCameraLocations(rg.Point3d(*target), rg.Point3d(*loc))


# ------------------------------------------------------- Grasshopper glue
LIGHT = (0.33, -0.47, 0.82)   # unit vector towards the light


def shaded(verts, faces, cols):
    """Give every face its own vertices and darken its colour by its
    orientation to a fixed light. Grasshopper draws vertex-coloured meshes
    without shading, so the shading is put into the colours here. The
    absolute value makes the result independent of the face winding."""
    V, F, C = [], [], []
    for f in faces:
        p0, p1, p2 = verts[f[0]], verts[f[1]], verts[f[-1]]
        ux, uy, uz = p1[0] - p0[0], p1[1] - p0[1], p1[2] - p0[2]
        vx, vy, vz = p2[0] - p0[0], p2[1] - p0[1], p2[2] - p0[2]
        nx, ny, nz = uy * vz - uz * vy, uz * vx - ux * vz, ux * vy - uy * vx
        ln = math.sqrt(nx * nx + ny * ny + nz * nz)
        if ln < 1e-12 and len(f) == 4:                   # degenerate corner
            p1 = verts[f[2]]
            ux, uy, uz = p1[0] - p0[0], p1[1] - p0[1], p1[2] - p0[2]
            nx, ny, nz = uy * vz - uz * vy, uz * vx - ux * vz, ux * vy - uy * vx
            ln = math.sqrt(nx * nx + ny * ny + nz * nz)
        lit = abs(nx * LIGHT[0] + ny * LIGHT[1] + nz * LIGHT[2]) / ln if ln > 1e-12 else 0.5
        k = 0.50 + 0.50 * lit
        base = cols[f[0]]
        c = tuple(int(round(base[j] * k)) for j in range(3))
        b = len(V)
        for idx in f:
            V.append(verts[idx])
            C.append(c)
        F.append(tuple(range(b, b + len(f))))
    return V, F, C


def _to_mesh(rg, verts, faces, cols):
    import System.Drawing as sd
    verts, faces, cols = shaded(verts, faces, cols)
    m = rg.Mesh()
    for v in verts:
        m.Vertices.Add(float(v[0]), float(v[1]), float(v[2]))
    for f in faces:
        if len(f) == 4:
            m.Faces.AddFace(f[0], f[1], f[2], f[3])
        else:
            m.Faces.AddFace(f[0], f[1], f[2])
    for c in cols:
        m.VertexColors.Add(sd.Color.FromArgb(c[0], c[1], c[2]))
    m.Normals.ComputeNormals()
    m.Compact()
    return m


def _auto_step(g, last):
    """Playback counter kept between solutions (needs a Trigger on Tick)."""
    import scriptcontext as sc
    key = "sapling_preview_step"
    step = float(sc.sticky.get(key, 0.0))
    if g.get("Play"):
        step += float(g.get("Rate") or 0.05)
        if step > last:
            step = 0.0                                   # loop
    sc.sticky[key] = step
    return step


def _gh_main():
    import Rhino.Geometry as rg
    g = globals()
    path = g.get("Path")
    if path is None:
        return None, None, None, "Connect a curve to Path"
    h = float(g.get("h") or 50.0)
    tl = float(g.get("tl") or 10.0)
    fail = g.get("Layers")
    fail = None if fail is None else int(fail)
    mode = g.get("Mode")
    mode = None if mode is None else str(mode).strip().lower()
    shape = g.get("Shape")
    # Sapling gives no mode shape for plastic collapse: the list is then
    # empty or holds a single null.
    if shape is not None and not isinstance(shape, (list, tuple)):
        shape = list(shape) if hasattr(shape, "__iter__") else [shape]
    shape = [float(v) for v in (shape or []) if v is not None]
    shape = shape if len(shape) >= 2 else None
    edge = (g.get("Edge") or "free").strip().lower()
    nseg = int(g.get("Segments") or 120)

    closed = bool(path.IsClosed)
    points, normals = [], []
    for t in path.DivideByCount(nseg, True):
        p, tan = path.PointAt(t), path.TangentAt(t)
        ln = math.hypot(tan.X, tan.Y) or 1.0
        points.append((p.X, p.Y))
        normals.append((-tan.Y / ln, tan.X / ln))

    last = (fail + COLLAPSE_STEPS + 2.0) if fail is not None else 40.0
    step = g.get("Step")
    step = _auto_step(g, last) if step is None else max(0.0, float(step))

    # Meshes are kept per set of inputs, so going back to values that were
    # already shown (e.g. dragging a slider back and forth) is immediate.
    import scriptcontext as sc
    cache = sc.sticky.setdefault("sapling_preview_meshes", {})
    if any(k[0] != BUILD for k in cache):
        cache.clear()
    key = (BUILD, tuple(points), closed, h, tl, round(step, 4), fail, mode,
           tuple(shape) if shape else None, edge)
    if key not in cache:
        if len(cache) > 60:              # keeps memory use modest
            cache.clear()
        verts, faces, cols, tip, amount = build_wall(
            points, normals, closed, h, tl, step, fail, mode, shape, edge)
        wall = _to_mesh(rg, verts, faces, cols) if verts else None

        top_layer = fail if fail is not None else 40
        rail_z = max(1.6 * frame_dims(points)[2], top_layer * tl + 450.0)
        moving, fixed = build_printer(points, tip, h, rail_z)
        nozzle, printer = _to_mesh(rg, *moving), _to_mesh(rg, *fixed)
        cache[key] = (wall, nozzle, printer, amount)
    wall, nozzle, printer, amount = cache[key]

    cam = g.get("Camera")
    cam = str(cam).strip().lower() if cam else ""
    if cam in ("story", "orbit", "true"):
        xs, ys = [p[0] for p in points], [p[1] for p in points]
        s, m, _ = frame_dims(points)
        radius = math.hypot(0.5 * (max(xs) - min(xs)) + m + s,
                            0.5 * (max(ys) - min(ys)) + m + s)
        centre = (0.5 * (max(xs) + min(xs)), 0.5 * (max(ys) + min(ys)))
        _set_camera(rg, *camera_pose(step, fail, tl, centre, radius,
                                     "orbit" if cam == "orbit" else "story",
                                     float(g.get("Zoom") or 1.0)))

    if amount is not None:
        status = "FAILURE at layer %d: %s" % (fail, mode or "")
        if amount > 0:
            status += "\n(deformed shape is illustrative)"
    else:
        status = "Layer %d of %s, height %.0f mm" % (
            int(step) + 1, "?" if fail is None else str(fail), step * tl)
    return wall, nozzle, printer, status


try:
    import Rhino  # noqa: F401  (only inside Rhino)
    Printed, Nozzle, Printer, Status = _gh_main()
except ImportError:
    pass
# ---------- end sapling_preview ----------
panel_4 = Panel(sapling_preview.Status)
